# Grasshopper definition Assignment-01_definition.gh (Grasshopper 1.0.7)
# plug-ins: Pufferfish, MeshEdit Components

random_seed = GetInteger(Slider(409, range=100..1000), AtLeast=1, AtMost=1, Maximum=2147483647, Minimum=-2147483648, TreeAccess=False)
box_width = GetInteger(Slider(18, range=0..30), AtLeast=1, AtMost=1, Maximum=2147483647, Minimum=-2147483648, TreeAccess=False)
box_length = GetInteger(Slider(18, range=0..20), AtLeast=1, AtMost=1, Maximum=2147483647, Minimum=-2147483648, TreeAccess=False)
box_height = GetInteger(Slider(10, range=0..10), AtLeast=1, AtMost=1, Maximum=2147483647, Minimum=-2147483648, TreeAccess=False)
max_height = GetInteger(Slider(19, range=0..25), AtLeast=1, AtMost=1, Maximum=2147483647, Minimum=-2147483648, TreeAccess=False)
box = CenterBox(Base=PlaneXY(0, 0, 0), X=box_width, Y=box_length, Z=box_height)
debrep = DeconstructBrep(Brep=box)  # -> Faces, Edges, Vertices
facen = FaceNormals(Mesh=debrep.Faces)  # -> Centers, Normals
Z = UnitZ(Factor=1)
cvec = ClosestVector(Reference=Z, Targets=flatten(facen.Normals), KeepLength=False)  # -> Closest, Index, Angle
number_slider = Slider(5, range=0..10)
cull_i = CullIndex(List=debrep.Faces, Indices=cvec.Index, Wrap=True)
item = ListItem(List=debrep.Faces, Index=cvec.Index, Wrap=True)
debrep_2 = DeconstructBrep(Brep=item)  # -> Faces, Edges, Vertices
rebsrf = RebuildSurface(Surface=item, CountU=number_slider, CountV=number_slider)
srfpt = SurfacePoints(Surface=rebsrf)  # -> Points, Weights, Greville, UCount, VCount
dom = ConstructDomain(DomainStart=Slider(0.5, range=0..1), DomainEnd=max_height)
join = JoinCurves(Curves=debrep_2.Edges, Preserve=False)
range = Range(Domain=dom, Steps=10)
partition = PartitionList(List=srfpt.Points, Size=number_slider)  # -> simplify(Chunks)
bnd = Bounds(Numbers=range)
pt = Point(partition)
subtraction = Subtraction(A=number_slider, B="2")
crv_cp = CurveClosestPoint(Point=pt, Curve=join)  # -> Point, Parameter, Distance
smaller = SmallerThan(FirstNumber=crv_cp.Distance, SecondNumber="1e-5")  # -> SmallerThan, OrEqualTo
dispatch = Dispatch(List=pt, DispatchPattern=smaller.SmallerThan)  # -> ListA, ListB
series = Series(Start="1", Step=1, Count=subtraction)  # -> graft(Series)
pt_2 = Point(simplify(dispatch.ListA))
path = ConstructPath(Indices=series)
lng = ListLength(List=dispatch.ListB)
branch = TreeBranch(Tree=simplify(dispatch.ListB), Path=path, MaintainPaths=True)
ma = MassAddition(Input=flatten(lng))  # -> Result, PartialResults
sort = SortList(Keys=flatten(lng))  # -> Keys, ValuesA
random = Random(Range=bnd, Number=ma.Result, Seed=random_seed)  # -> simplify(Random)
item_2 = ListItem(List=sort.Keys, Index="-1", Wrap=True)
partition_2 = PartitionList(List=random, Size=item_2)
Z_2 = UnitZ(Factor=partition_2)
move = Move(Geometry=branch, Motion=Z_2)  # -> Geometry, Transform
match = MatchTree(Tree=move.Geometry, Guide=branch)
merge = Merge(Data1=pt_2, Data2=match)
pdecon = Deconstruct(Point=merge)  # -> XComponent, YComponent, ZComponent
srf = Surface(cull_i)
mesh = Mesh(srf)
sort_2 = SortList(Keys=pdecon.YComponent, ValuesA=merge)  # -> Keys, ValuesA
frompoints = MeshFromPoints(Points=flatten(sort_2.ValuesA), UDirection=number_slider, VDirection=number_slider)
merge_2 = Merge(Data1=mesh, Data2=frompoints)
mjoin = MeshJoin(Meshes=flatten(merge_2))

# ---- group: RH_OUT:RenBox
medges = MeshEdges(Mesh=mjoin)  # -> NakedEdges, InteriorEdges, NonManifoldEdges
mesh_2 = Mesh(mjoin)
